% Simulink data dictionary EP21_ACCAEB_Interface.sldd

AccAebOutputs = Simulink.Bus(DataScope="Exported", HeaderFile="SVDC_ACCAEB_Interface")
  ACCMinBrkReqStsHSC2_u8: uint8
  ACCAccReqValHSC2_sg: single
  ACCAccReqValTolMaxHSC2_sg: single
  ACCReqBrkPrfrdHSC2_u8: uint8
  ACCAccReqStsHSC2_u8: uint8
  ACCGoReqHSC2_u8: uint8
  ACCSysFltSts_SCSHSC2_u8: uint8
  ACCSysSts_RadarHSC2_u8: uint8
  ChACCShtdwnMdHSC2_u8: uint8
  ACCAccReqValTolMinHSC2_sg: single
  ACCSdslReq_RadarHSC2_u8: uint8
  ACCSysAlvRlngCtr_SCSHSC2_u8: uint8
  ACCSysChksm_SCSHSC2_u8: uint8
  AEBDclReqValHSC2_sg: single
  ACCAccReqValGrdMaxHSC2_sg: single
  AEBPrflReqHSC2_u8: uint8
  ACCAEBBrkJerkLvlReq_RadarHSC2_u8: uint8
  AEBSysSts_RadarHSC2_u8: uint8
  AEBDclReqStsHSC2_u8: uint8
  AEBPedtrnSysStsHSC2_u8: uint8
  AEBHydBrkAstLvlReqHSC2_u8: uint8
  AEBPedtrnSysFltStsHSC2_u8: uint8
  AEBSysFltSts_RadarHSC2_u8: uint8
  ACCAccReqValGrdMinHSC2_sg: single
  AEBAlvRlngCtr_SCSHSC2_u8: uint8
  AEBChksm_SCSHSC2_u8: uint8
  ACCObjDet_RadarHSC2_u8: uint8
  ACCDrvrSelTrgtSpd_RadarHSC2_sg: single
  AEBMsgReqHSC2_u8: uint8
  ACCMsgReqHSC2_u8: uint8
  ACCDetObjDistLvl_RadarHSC2_u8: uint8
  ACCDrvrSeldTrgtDistLvl_RadarHSC2_u8: uint8
  ACCSysCanclReq_RadarHSC2_u8: uint8
  RdrCalPrgsReqHSC2_u8: uint8
  ACCGoNotfr_RadarHSC2_u8: uint8
  ACCSysFltSts_RadarHSC2_u8: uint8
  ACCDrvrTkovReqHSC2_u8: uint8
  FCWSysFltSts_RadarHSC2_u8: uint8
  FCWSnstvtLvl_RadarHSC2_u8: uint8
  AEBPedtrnDspCmdHSC2_u8: uint8
  FCWrnngSts_RadarHSC2_u8: uint8
  FCWDspCmd_RadarHSC2_u8: uint8
  AEBDspCmd_RadarHSC2_u8: uint8
  FCWTimeToColHSC2_sg: single
  ObsDataSyncCtrHSC2_u8: uint8
  PedtrnColWrnngAHSC2_u8: uint8
  ObsDataTmspHSC2_sg: single
  FCWAHSC2_u8: uint8
  ACCToqReqValPVHSC2_sg: single
  ACCToqReqValHSC2_sg: single
  ACCToqReqStsHSC2_u8: uint8
  ACCAlvRCHSC2_u8: uint8
  DFIn_v_EgoAvgVehSpd_sg: single
  DFIn_yr_VehDynYawRate_sg: single
  ACCSysTgtAccel_sg: single
  ACCReqSts_u8: uint8
  ACCDesiredDis_sg: single
  ACC_V_ACCSetSpd_sg: single
  ACC_V_ACCMemSpd_sg: single
  ARB_ACCAEBDclReqV_sg: single
  DFIn_V_HdVehSpd_sg: single
  ACC_a_FixedSpdCtrl_sg: single
  ACC_a_EmerSpdCtrl_sg: single
  ACC_a_LowSpdCtrl_sg: single
  ACC_a_HighSpdCtrl_sg: single
  tester1_0: single
  tester2_0: single
  tester3_0: single
  tester4_0: single
  tester5_0: single
  tester6_0: single
  tester7_0: single
  tester8_0: single
  tester9_0: single
  testerA_0: single
  testerB_0: single
  tester1_1: single
  tester2_1: single
  tester3_1: single
  tester4_1: single
  tester5_1: single
  tester6_1: single
  tester7_1: single
  tester8_1: single
  tester9_1: single
  testerA_1: single
  testerB_1: single
  tester1_2: single
  tester2_2: single
  tester3_2: single
  tester4_2: single
  tester5_2: single
  tester6_2: single
  tester7_2: single
  tester8_2: single
  tester9_2: single
  testerA_2: single
  testerB_2: single