% Simulink data dictionary Platform_ACCAEB_CORE.sldd
% references Platform_ACCAEB_CORE_IN.sldd
% references EP21_ACCAEB_Interface.sldd

Air_Area = 3.1
Air_Density = 1.2258
Air_Resistance_Ratio = 0.4547
C_system_step = 0.01
DCT_Mech_Ratio = 0.9
K_AEBActDis_Hyst = 2
K_AEBActivemin = 2
K_AEBDisNd_Hyst = 2
K_AccPdlRt = 10
K_TTC_brk = 0
K_VehSpd_Hyst = 1
K_drv_delay = 1
K_sys_drv_delay = 1.2
K_wrn_offset = 5
Mass_AS22_20T = 1800
Rolling_Resistance = 0.009
V_Max_Acc_g = 6
t_Sample_HndrdHz = 0.01
VLC_VAC_ACCSysReqSts_en = Simulink.Signal(StorageClass="ExportedGlobal")
K_ACC_Low_Spd = Simulink.Parameter(10, StorageClass="ExportedGlobal")
ACCAEBTgtLockSts = Simulink.Signal(StorageClass="ExportedGlobal")
DrvMforECMAlvRCHSC1 = Simulink.Signal(StorageClass="ExportedGlobal")
TrShftLvrPosHSC1_u8 = Simulink.Signal(StorageClass="ExportedGlobal")
ACCAEBDclReqStsHSC2 = Simulink.Signal(StorageClass="ExportedGlobal")
ACCAEBDclReqValHSC2 = Simulink.Signal(StorageClass="ExportedGlobal")
P_VDC_ACC_v_FusTrajCrvteLoRt_sg = Simulink.Parameter(-20000, StorageClass="ExportedGlobal", DataType="single")
P_VDC_ACC_v_FusTrajCrvteRUpRt_sg = Simulink.Parameter(500, StorageClass="ExportedGlobal", DataType="single")
T_P_VDC_ACC_Gx_AccelCtrlCoe_sg = Simulink.Parameter([1.0461 1.0918 0.7274], StorageClass="ExportedGlobal", DataType="single")
P_VDC_Rt_CSCAccelUp_sg = Simulink.Parameter(1, StorageClass="ExportedGlobal", DataType="single")
P_VDC_Rt_CSCAccelLo_sg = Simulink.Parameter(-1.5, StorageClass="ExportedGlobal", DataType="single")
VDC_r_ACCTrajDynCrvte_sg = Simulink.Signal(StorageClass="ExportedGlobal", DataType="single")
ACC_k_TrajDynCrvte_sg = Simulink.Signal(StorageClass="ExportedGlobal", DataType="single", Unit="1/m")  % Signal_Curvature value from vehicle dynamics;
ACC_v_MaxCrvteSpd_sg = Simulink.Signal(StorageClass="ExportedGlobal", DataType="single", Unit="m/s")  % Signal_Maximum Allowed Vehicle Speed by Curve Speed Control module;
DFIn_is_FMCEgoLaneErr_bl = Simulink.Signal(StorageClass="ExportedGlobal", DataType="boolean")  % Signal_Lane information status from Camera; 1 means error and low confidence level;
DFIn_r_FMCEgoLaneAvgR_sg = Simulink.Signal(StorageClass="ExportedGlobal", DataType="single", Unit="m")  % Signal_Lane Radius from Camera;
P_ACC_Gx_CSCMaxLatAccelCoe_sg = Simulink.Parameter(0.7, StorageClass="ExportedGlobal", DataType="single")  % Para_the gain to adjust the lateral Maximum Acceleration threshold, which will influence the MaxCurveSpeed;
P_DFIn_rRt_FMCLaneAvgRLo_sg = Simulink.Parameter(-10000, StorageClass="ExportedGlobal", DataType="single", Unit="m")  % Para_the allowed decrease rate of curve raduis;
P_DFIn_rRt_FMCLaneAvgRUp_sg = Simulink.Parameter(500, StorageClass="ExportedGlobal", DataType="single", Unit="m")  % Para_the allowed increase rate of curve raduis;
P_T_VDC_ACC_SpdCtrlCoe_sg = Simulink.Parameter([1.0461 0.9169 0.6316], StorageClass="ExportedGlobal", DataType="single")  % P_the speed gain due to variant target distance in the Follow target control mode;
P_VDC_ACC_cnt_ModeSwFSC_u16 = Simulink.Parameter(60, StorageClass="ExportedGlobal", DataType="uint16")  % Para_only when the counter is larger than this para, is the FSC allowed to enter into from other modes;
P_VDC_ACC_CrvteCalSpdThrs_sg = Simulink.Parameter(1, StorageClass="ExportedGlobal", DataType="single", Unit="m/s")  % Para_ different curvature algorithm between larger and smaller than this speed.
P_VDC_ACC_Gx_AccelCtrlCoe_sg = Simulink.Parameter(0.7274, StorageClass="ExportedGlobal", DataType="single")  % P_FTC gain
P_VDC_ACC_Gx_LneFsnCMRCnfdn_sg = Simulink.Parameter(0.3, StorageClass="ExportedGlobal", DataType="single")  % Para_the gain times the calculated raduis and the 1-gain times the observed raduis from camera;
P_ACC_d_FTCCutInOfstDist_sg = Simulink.Parameter(1.5, StorageClass="ExportedGlobal", DataType="single", Unit="m")  % P_when the time distance is ZERO, this minimum distance threshold is this value;
P_VDC_aRt_ARBACCLo_sg = Simulink.Parameter(-2.5, StorageClass="ExportedGlobal", DataType="single", Unit="m/s^3")  % Para_allowed the acceleration decrease rate in Arbitration module;
P_VDC_aRt_ARBDeceltnLo_sg = Simulink.Parameter(-2, StorageClass="ExportedGlobal", DataType="single", Unit="m/s^3")  % Para_the rate for comfort use; the larger absolute value, the more dynamics;
P_VDC_Gx_FTCCutInSftyDistHyst_sg = Simulink.Parameter(0.8, StorageClass="ExportedGlobal", DataType="single")  % Para_the data is used to multiply with FTCCUTIn Minimum Dist to creat a hysteresis to avoid the debounce;
P_ACC_Gx_CSCSpdDecCoe_sg = Simulink.Parameter(0.4, StorageClass="ExportedGlobal", DataType="single")  % Para_the control gain for speed decrease in CSC mode;

P_ACC_v_FSCMinThrs_sg = Simulink.Parameter(3, StorageClass="ExportedGlobal", DataType="single", Unit="m/s")  % /*In FSC, when the vehicle speed is larger than this
  % value, a unique gain will be applied
  % For example 3 m/s*/

P_ACC_v_FSCMinThrsHys_sg = Simulink.Parameter(2, StorageClass="ExportedGlobal", DataType="single", Unit="m/s")  % /*In FSC, when the vehicle speed is lower than this
  % value, a unique gain will be applied. Noticeably, the value
  % should be less than FSCMinThrs.
  % For example 2 m/s */

P_ACC_Gx_FTCDistCtrlCoe_sg = Simulink.Parameter(0.223, StorageClass="ExportedGlobal", DataType="single")  % P_FTC gain
ACC_r_FusTrajCrvte_sg = Simulink.Signal(StorageClass="ExportedGlobal", DataType="single", Unit="m")  % /* crvte radius after fusion with camera signal*/
P_ACC_Gx_FTCSpdCtrlCoe_sg = Simulink.Parameter(0.6316, StorageClass="ExportedGlobal", DataType="single")  % P_FTC Gain
DFIn_v_HdVehSpd_sg = Simulink.Signal(StorageClass="ExportedGlobal", DataType="single", Unit="m/s")  % /*the objective vehicle velocity, usually is positive value unless less than -1.2m/s/s */
DFIn_v_EgoAvgVehSpd_sg = Simulink.Signal(StorageClass="ExportedGlobal", DataType="single", Unit="m/s")  % /*Self Vehicle speed after filtered */
DFIn_d_FMRdrLongtDist_sg = Simulink.Signal(StorageClass="ExportedGlobal", DataType="single", Unit="m")  % /*Longtitudinal distance from Radar*/
DFIn_d_FMRdrLatDist_sg = Simulink.Signal(StorageClass="ExportedGlobal", DataType="single", Unit="m")  % /*Lateral distance from Radar*/
P_DFIn_t_AEBActvTm_u8 = Simulink.Parameter(3, StorageClass="ExportedGlobal", DataType="uint8")  % /* allowed to be activited when the time counter is larger than this time value*/
DFIn_indx_AEBSwSts_en = Simulink.Signal(StorageClass="ExportedGlobal", DataType="single")
P_DFIn_v_LanePrewLoThrs_u8 = Simulink.Parameter(10, StorageClass="ExportedGlobal", DataType="uint8", Unit="m/s")  % /* when the speed is larger than this value, longer preview time is needed.*/

P_DFIn_t_PrewTmDistLoSpd_sg = Simulink.Parameter(1, StorageClass="ExportedGlobal", DataType="single", Unit="sec")  % /* the preview time related with Low speed
  % For example 1 sec*/

P_DFIn_t_PrewTmDistHiSpd_sg = Simulink.Parameter(1.3, StorageClass="ExportedGlobal", DataType="single", Unit="sec")  % /* the preview time related with high speed,
  % For example 1.3sec */

DFIn_r_FMCLane1R_sg = Simulink.Signal(StorageClass="ExportedGlobal", DataType="single", Unit="m")  % /*Main Lane, right lane radius*/
DFIn_r_FMCLane0R_sg = Simulink.Signal(StorageClass="ExportedGlobal", DataType="single", Unit="m")  % /*Main Lane, left lane radius*/
DFIn_d_FMCPrewPoint_sg = Simulink.Signal(StorageClass="ExportedGlobal", DataType="single", Unit="m")  % /*Prvwed distanc*/
ACC_r_TrajDynCrvte_sg = Simulink.Signal(StorageClass="ExportedGlobal", DataType="single", Unit="m")  % /* Vehicle Planning Lane Radius*/
ACC_a_CSCAccel_sg = Simulink.Signal(StorageClass="ExportedGlobal", DataType="single", Unit="m/s^2")  % /*Acceleration output in Curve Module*/
ACC_v_ACCSetSpd_sg = Simulink.Signal(StorageClass="ExportedGlobal", DataType="single", Unit="m/s")  % /*Driver Set Speed*/
ACC_a_FSCAccelCmft_sg = Simulink.Signal(StorageClass="ExportedGlobal", DataType="single", Unit="m/s^2")
ACC_a_FSCAccelNor_sg = Simulink.Signal(StorageClass="ExportedGlobal", DataType="single", Unit="m/s^2")
ACC_a_FSCAccelSpt_sg = Simulink.Signal(StorageClass="ExportedGlobal", DataType="single", Unit="m/s^2")
ACC_indx_ACCDrvrMode_en = Simulink.Signal(StorageClass="ExportedGlobal", DataType="uint8")
ACC_is_FTCCutInSatfd_bl = Simulink.Signal(StorageClass="ExportedGlobal", DataType="boolean")
ACC_is_FTCCutInKpSpd_bl = Simulink.Signal(StorageClass="ExportedGlobal", DataType="boolean")
ACC_a_CSCAccelCalc_sg = Simulink.Signal(StorageClass="ExportedGlobal", DataType="single", Unit="m/s^2")  % /*Calculated CSC Value*/
ACC_a_MaxLatAcc_sg = Simulink.Signal(StorageClass="ExportedGlobal", DataType="single", Unit="m/s^2")  % /*Allowed Max lateral accele threshold*/
DFIn_perc_AccelActuPos_sg = Simulink.Signal(StorageClass="ExportedGlobal", DataType="single")  % /*Actual position*/
DFIn_perc_AccelEfctvPos_sg = Simulink.Signal(StorageClass="ExportedGlobal", DataType="single")
DFIn_is_ACCReqEnable_bl = Simulink.Signal(StorageClass="ExportedGlobal", DataType="boolean")
DFIn_indx_ACCAEBTgtLockSts_en = Simulink.Signal(StorageClass="ExportedGlobal", DataType="single")
DFIn_indx_BrkPdlSts_en = Simulink.Signal(StorageClass="ExportedGlobal", DataType="Enum: BrkPdlSw_t")
DFIn_is_BrkOnlyEnbl_bl = Simulink.Signal(StorageClass="ExportedGlobal", DataType="boolean")
DFIn_a_VSELongtAccel_sg = Simulink.Signal(StorageClass="ExportedGlobal", DataType="single", Unit="m/s^2")  % /*Actual Vehicle Acceleration*/
DFIn_perc_BrkPdlPos_sg = Simulink.Signal(StorageClass="ExportedGlobal", DataType="single", Unit="perc")
DFIn_angD_StrgWhlAng_sg = Simulink.Signal(StorageClass="ExportedGlobal", DataType="single")
DFIn_yr_VehDynYawRate_sg = Simulink.Signal(StorageClass="ExportedGlobal", DataType="single", Unit="deg/s")
DFIn_indx_TrEstdGear_u8 = Simulink.Signal(StorageClass="ExportedGlobal", DataType="uint8")
DFIn_is_SesrFlr_bl = Simulink.Signal(StorageClass="ExportedGlobal", DataType="boolean")
DFIn_is_ACCSwOnSw_bl = Simulink.Signal(StorageClass="ExportedGlobal", DataType="boolean")
DFIn_is_ACCSwCanclSw_bl = Simulink.Signal(StorageClass="ExportedGlobal", DataType="boolean")
DFIn_is_ACCSwRsmSw_bl = Simulink.Signal(StorageClass="ExportedGlobal", DataType="boolean")
DFIn_is_ACCSwSetSw_bl = Simulink.Signal(StorageClass="ExportedGlobal", DataType="boolean")
DFIn_is_ACCSwSpdIncSw_bl = Simulink.Signal(StorageClass="ExportedGlobal", DataType="boolean")
DFIn_is_ACCSwSpdIncSwHld_bl = Simulink.Signal(StorageClass="ExportedGlobal", DataType="boolean")
DFIn_is_ACCSwSpdIncSwHldCmd_bl = Simulink.Signal(StorageClass="ExportedGlobal", DataType="boolean")
DFIn_is_ACCSwSpdDecSw_bl = Simulink.Signal(StorageClass="ExportedGlobal", DataType="boolean")
DFIn_is_ACCSwSpdDecSwHld_bl = Simulink.Signal(StorageClass="ExportedGlobal", DataType="boolean")
DFIn_is_ACCSwSpdDecSwHldCmd_bl = Simulink.Signal(StorageClass="ExportedGlobal", DataType="boolean")
DFIn_is_ACCSwRsmSwHld_bl = Simulink.Signal(StorageClass="ExportedGlobal", DataType="boolean")
DFIn_is_ACCSwRsmSwHldCmd_bl = Simulink.Signal(StorageClass="ExportedGlobal", DataType="boolean")
P_ACC_perc_AccelPdlPosThrsLo_sg = Simulink.Parameter(0.05, StorageClass="ExportedGlobal", DataType="single")  % /* when lower than this value, ACC override exit*/
C_is_FMCEgoLaneErr_bl = Simulink.Parameter(1, StorageClass="ExportedGlobal", DataType="boolean")
P_ACC_Gx_CSCSpdIncCoe_sg = Simulink.Parameter(0.2, StorageClass="ExportedGlobal", DataType="single")  % Para_the control gain for speed increase in CSC mode;
P_DFIn_perc_AccelEfctvPos_sg = Simulink.Parameter(0.2, StorageClass="ExportedGlobal", DataType="single")  % /*tester signal. Since the effective Accel Position signal from CAN bus is abnormal*/

ACC_indx_ACCSysReqSts_en = Simulink.Signal(StorageClass="ExportedGlobal", DataType="Enum: ACCReqSts_t")  % /*
  % Sleep(0),
  % Off(1),
  % Standby(2),
  % Active(3),
  % BrkOnly(4)
  % ActiveOverride(5),
  % Activ (6),
  % CCC(7),
  % ACC(8),
  % ACCEmergency(9),
  % ACCApproaching(10),
  % ACCStop(11),
  % ACCStatictoStill(12),
  % ACCStdStill(13),
  % ACCCurve(14),
  % InActive(15),*/

P_RCA_v_MaxSpdIncDelt_sg = Simulink.Parameter(10, StorageClass="ExportedGlobal", DataType="single")  % /* The allowed Maximum Speed Increase value increased by RCA system,
  % e.g. 2m/s^2*/

P_VDC_aRt_ARBACCUp_sg = Simulink.Parameter(20, StorageClass="ExportedGlobal", DataType="single", Unit="m/s^3")  % Para_allowed the acceleration increase rate in Arbitration module;
P_VDC_aRt_ARBDeceltnUp_sg = Simulink.Parameter(20, StorageClass="ExportedGlobal", DataType="single", Unit="m/s^3")  % Para_the rate for comfort use; the larger absolute value, the more dynamics;
P_VDC_v_FTCCutInSftymin_sg = Simulink.Parameter(0.6, StorageClass="ExportedGlobal", DataType="single", Unit="m/s")  % Para_the velocity threshold, when smaller than the value, the ego vehicle will decrease obviously ;otherwise, just idle or keep average speed;
P_VDC_v_FTCCutInSftyHysmin_sg = Simulink.Parameter(0.4, StorageClass="ExportedGlobal", DataType="single", Unit="m/s")  % Para_the velocity threshold hysteresis in cut in mode;

P_ACC_v_FTCCutInSfty_sg = Simulink.Parameter(0.6, StorageClass="ExportedGlobal", DataType="single", Unit="m/s")  % /*Velocity threshold, when smaller than the value but larger than
  % the Safty Minimum Velocity, the ego vehicle will idle;if larger than the velocity, the vehicle will runs at a constant speed*/

P_ACC_is_AccelEfctvPosTester_bl = Simulink.Parameter(0, StorageClass="ExportedGlobal", DataType="boolean")

P_DFIn_perc_AccelPosHysDelt_sg = Simulink.Parameter(0, StorageClass="ExportedGlobal", DataType="single", Unit="perc")  % /* when the effective acceleration pedal position is larger than
  % the driver actual pedal position, and the difference is larger than this value,
  % the system may enter into OVERRIDE Mode*/

P_ACC_v_MaxCrsSpdThrs_u8 = Simulink.Parameter(40, StorageClass="ExportedGlobal", DataType="uint8")  % The Maximum allowed Set Speed. When driver drives vehicle with a speed higher
  % thanthis value, and then press the Set Button, the speed will be set as this parameter value.

P_DFIn_indx_IniCruzTmDist_u8 = Simulink.Parameter(2, StorageClass="ExportedGlobal", DataType="uint8")  % /*Time Distance_1 means 1sec, 2 means 1.5sec and 3 means 2 secs*/
DFIn_indx_ACCTmDist_en = Simulink.Signal(StorageClass="ExportedGlobal", DataType="single")
P_ACC_Gx_FSCDecCoe_sg = Simulink.Parameter(1.6, StorageClass="ExportedGlobal", DataType="single")  % /* the gain is used when the the set speed is lower than the actual vehicle speed*/

P_ACC_v_idlBrkErrThrs_sg = Simulink.Parameter(0.2, StorageClass="ExportedGlobal", DataType="single", Unit="m/s")  % when the tracking error is smaller than the value, the system can be switched to ActvBrake State like the initial state.
  % Because we think the Actv Brake state are much safer.
  % For example: 0.2m/s

C_AS21_20T_GearRat_Tbl1D = Simulink.Parameter([13.903 8.042 5.158 3.839 2.936 2.267 1 1], StorageClass="ExportedGlobal", DataType="single")  % The Gear ratio of AS21 2.0T
C_EP21_AnyT_GearRat_Tbl1D = Simulink.Parameter(repmat(7.378, 1, 8), StorageClass="ExportedGlobal", DataType="single")  % The gear ratio of EP21 Vehicle for any configuation.

P_ACC_Gx_FSCIntglCoeLow_sg = Simulink.Parameter(0.005, StorageClass="ExportedGlobal", DataType="single")  % /*Fixed Speed Cruise Integral Gain;
  % For example 0.005*/

ACC_a_FSCAccelCalc_sg = Simulink.Signal(StorageClass="ExportedGlobal", DataType="single", Unit="m/s^2")  % The acceleration value calculated by the FSC subsystem.
ACC_a_ACCSysTgtAccel_sg = Simulink.Signal(StorageClass="ExportedGlobal", DataType="single", Unit="m/s^2")  % /*ACC system acceleration output*/
ACC_a_FSCAccel_sg = Simulink.Signal(StorageClass="ExportedGlobal", DataType="single", Unit="m/s^2")
ACC_a_FSCIntgl_sg = Simulink.Signal(StorageClass="ExportedGlobal", DataType="single", Unit="m/s^2")  % The acceleration value contributed by integral part in FSC system.
ACC_a_FSCProp_sg = Simulink.Signal(StorageClass="ExportedGlobal", DataType="single", Unit="m/s^2")  % The value is the acceleration contributed by the proportional part.
ACC_a_FTCAccel_sg = Simulink.Signal(StorageClass="ExportedGlobal", DataType="single", Unit="m/s^2")
ACC_a_FTCAccelCalc_sg = Simulink.Signal(StorageClass="ExportedGlobal", DataType="single", Unit="m/s^2")
ACC_a_FTCAccelEmer_sg = Simulink.Signal(StorageClass="ExportedGlobal", DataType="single", Unit="m/s^2")
ACC_a_FTCAccelSBF_sg = Simulink.Signal(StorageClass="ExportedGlobal", DataType="single", Unit="m/s^2")
ACC_a_SetSpdErr_sg = Simulink.Signal(StorageClass="ExportedGlobal", DataType="single", Unit="m/s^2")
C_ACC_a_FTCCutInSftyAccel_sg = Simulink.Parameter(0, StorageClass="ExportedGlobal", DataType="single", Unit="m/s^2")  % Para_when meeting cut-in case, the acceleration output;
DFIn_a_EstdVSELongtAccel_sg = Simulink.Signal(StorageClass="ExportedGlobal", DataType="single", Unit="m/s^2")  % Estimated Vehicle Acceleration value by wheel speed filter
P_ACC_a_FSCIntglLoLmt_sg = Simulink.Parameter(-0.3, StorageClass="ExportedGlobal", DataType="single", Unit="m/s^2")  % To limit the unexpected integral part influence to P_ACC_a_FSCIntglUpLmt_sg
P_ACC_a_FSCIntglUpLmt_sg = Simulink.Parameter(0.3, StorageClass="ExportedGlobal", DataType="single", Unit="m/s^2")  % To limit the unexpected integral part influence upto P_ACC_a_FSCIntglUpLmt_sg
P_ACC_aRt_FSCCmftLoRt_sg = Simulink.Parameter(-2.5, StorageClass="ExportedGlobal", DataType="single", Unit="m/s^3")
P_ACC_aRt_FSCNorLoRt_sg = Simulink.Parameter(-2.5, StorageClass="ExportedGlobal", DataType="single", Unit="m/s^3")
P_ACC_aRt_FTCAccelMdlCalcLo_sg = Simulink.Parameter(-3, StorageClass="ExportedGlobal", DataType="single", Unit="m/s^3")
P_ACC_aRt_FTCAccelMdlCalcUp_sg = Simulink.Parameter(20, StorageClass="ExportedGlobal", DataType="single", Unit="m/s^3")
P_DFIn_aRt_EstdVSELongtAccelLo_sg = Simulink.Parameter(-4, StorageClass="ExportedGlobal", DataType="single", Unit="m/s^3")  % loside limit = P_DFIn_aRt_EstdVSELongtAccelLo_sg * sample time

P_DFIn_aRt_EstdVSELongtAccelUp_sg = Simulink.Parameter(4, StorageClass="ExportedGlobal", DataType="single", Unit="m/s^3")  % The upside rate limit of Estimated longitudinal acceleration.
  % Increase limit= sample time *DFIn_aRt_EstdVSELongtAccelUp_sg

P_ACC_v_idlBrkEghMinSpd_sg = Simulink.Parameter(3, StorageClass="ExportedGlobal", DataType="single", Unit="m/s")  % When the vehicle speed is lower than this value, the estimation of whether idle brake torque is enough is aborted, since
  % the acceleration estimated may not be precise enough.

P_ACC_Gx_FSCDecCoeLo_sg = Simulink.Parameter(0.3, StorageClass="ExportedGlobal", DataType="single")  % when EgoSpd > SetSpd,
  % when the Err is small,
  % the parameter will be used as the Proportional Gain.

P_ACC_is_FSCIntglOn_sg = Simulink.Parameter(1, StorageClass="ExportedGlobal", DataType="single")  % Fixed Speed Integral Switch;
  % 0 OFF
  % 1 On

C_AS21_20T_TorqCmpSATPosVal_Tbl1D = Simulink.Parameter([14.9169 25.7883 40.2073 54.0217 70.6366 91.48 100 100], StorageClass="ExportedGlobal", DataType="single", Unit="Nm")  % The value is used to limit the engine torque compensation.
  % The table can be obtained by the  m*a/ r/ gear_ratio.

C_EP21_20T_TorqCmpSATPosVal_Tbl1D = Simulink.Parameter(repmat(28, 1, 8), StorageClass="ExportedGlobal", DataType="single")
ACC_a_FTCAccelLn_sg = Simulink.Signal(StorageClass="ExportedGlobal", DataType="single", Unit="m/s^2")  % Add an Rate filter P_ACC_aRt_FTCAccelMdlCalcUp_sg for the signal ACC_a_FTCAccelCalc_sg.
ARB_a_ACCAEBDclReqVal_sg = Simulink.Signal(StorageClass="ExportedGlobal", DataType="single", Unit="m/s^2")  % The accaeb deceleration value to CAN bus

ARB_indx_ACCAEBDclReqSts_u8 = Simulink.Signal(StorageClass="ExportedGlobal", DataType="uint8")  % 0 No intervention
  % 1 ACC
  % 2 AEB

ARB_indx_ACCESPECMActvSts_en = Simulink.Signal(StorageClass="ExportedGlobal", DataType="Enum: ACCESPECMReqSts_t")  % eACCReqActive(0),
  % eACCHighESPActive(1),
  % eACCHighIdle(2),
  % eACCHighECMActive(3),
  % eACCLowESPActive(4),
  % eACCLowIdle(5),
  % eACCLowECMActive(6),
  % eACCReqInactive(7),

ARB_a_ESPCtrlThrs_sg = Simulink.Signal(StorageClass="ExportedGlobal", DataType="single", Unit="m/s^2")  % When the requested acceleration is smaller than this value, ESP active braking will be applied.
ARB_a_ECMCtrlThrs_sg = Simulink.Signal(StorageClass="ExportedGlobal", DataType="single", Unit="m/s^2")  % When the requested acceleration is smaller than this value but larger than ARB_a_ESPCtrlThrs_sg, EMS  active braking will be applied.
P_ARB_TRt_ACCTorqCmpUp_sg = Simulink.Parameter(20, StorageClass="ExportedGlobal", DataType="single", Unit="Nm/s")
ARB_T_ACCTorqCmpValRAW_sg = Simulink.Signal(StorageClass="ExportedGlobal", DataType="single", Unit="Nm")
ARB_T_ACCTorqCmpValRtLmt_sg = Simulink.Signal(StorageClass="ExportedGlobal", DataType="single", Unit="Nm")

ACC_is_ACCGoReqEn_bl = Simulink.Signal(StorageClass="ExportedGlobal", DataType="boolean")  % 0  conditions not satisfied
  % 1  auto following conditions are satisfied,

ACC_is_ACCSdslReq_bl = Simulink.Signal(StorageClass="ExportedGlobal", DataType="boolean")  % 0 Standstill conditions are not satisfied
  % 1 Standstill conditions are satisfied.

ACC_d_ACCEntryDist_sg = Simulink.Signal(StorageClass="ExportedGlobal", DataType="single", Unit="m")  % ACC Entry Distance
ACC_d_ACCDsrdDist_sg = Simulink.Signal(StorageClass="ExportedGlobal", DataType="single", Unit="m")  % ACC Desired Distance
ACC_indx_ACCSwSts_u8 = Simulink.Signal(StorageClass="ExportedGlobal", DataType="uint8")
ACC_v_SetSpdErr_sg = Simulink.Signal(StorageClass="ExportedGlobal", DataType="single", Unit="m/s")  % Value = DriverSetSpeed- EgoVehSpd;

ACC_is_idlBrkCycOvr_bl = Simulink.Signal(StorageClass="ExportedGlobal", DataType="boolean")  % The signal is used to avoid the exit delay of idle brake caused by accelpdl override;
  % 0 means still in idle brake cycle
  % 1 means cycle over;

ACC_is_FSCActvBrkIntv_bl = Simulink.Signal(StorageClass="ExportedGlobal", DataType="boolean")  % 0x0  smoothly idling
  % 0x1  Active Braking

P_ARB_aRt_EstdVSELongtAccelUp_sg = Simulink.Parameter(2, StorageClass="ExportedGlobal", DataType="single", Unit="m/s^3")
ARB_a_EstdVSELongtAccel_sg = Simulink.Signal(StorageClass="ExportedGlobal", DataType="single")  % After filter in ARB to avoid the small slope

P_ACC_is_OAFSwitchedOn_bl = Simulink.Parameter(0, StorageClass="ExportedGlobal", DataType="boolean")  % 0 OAF forbidden
  % 1 OAF Honored

ACC_V_ACCSetSpd_sg = Simulink.Signal(StorageClass="ExportedGlobal", DataType="single", Unit="Km/h")  % The set speed from the ACC Switch model
ACC_V_ACCMemSpd_sg = Simulink.Signal(StorageClass="ExportedGlobal", DataType="single", Unit="Km/h")

P_ACC_Gx_FSCDecCoeHi_sg = Simulink.Parameter(0.7, StorageClass="ExportedGlobal", DataType="single")  % when EgoSpd > SetSpd,
  % when the Err is large,
  % the parameter will be used as the Proportional Gain.

ACC_V_ACCSetSpdIPK_sg = Simulink.Signal(StorageClass="ExportedGlobal", DataType="single", Unit="Km/h")  % The ACC Set Speed Output to IPK instrument.
ACC_d_RltDistErr_sg = Simulink.Signal(StorageClass="ExportedGlobal", DataType="single", Unit="m")

ACC_is_OverDrvrSetSpd_bl = Simulink.Signal(StorageClass="ExportedGlobal", DataType="boolean")  % 1  Ego Spd >SetSpd
  % 0  Ego Spd <SetSpd

ACC_cntr_OvrrdExitTmThrsCntr_sg = Simulink.Signal(StorageClass="ExportedGlobal", DataType="single")
ARB_T_ACCPTDrvnToqEqlPt_sg = Simulink.Signal(StorageClass="ExportedGlobal", DataType="single", Unit="Nm")  % The value is the basic value without the control compensation of feedback control
ARB_T_ACCPTDrvnTorqCmpVal_sg = Simulink.Signal(StorageClass="ExportedGlobal", DataType="single", Unit="Nm")  % The output value of ACC acceleration closed loop under the limitation of Slope compensation
ARB_T_WhlDrvnToqMass_sg = Simulink.Signal(StorageClass="ExportedGlobal", DataType="single")  % The wheel driven torque based on the Equation: Mass* acceleration.
ARB_T_WhlDrvnToqRollResist_sg = Simulink.Signal(StorageClass="ExportedGlobal", DataType="single")  % The wheel driven torque based on the Equation: Mass* g* RollingResistance.
ARB_T_WhlDrvnToqAirResist_sg = Simulink.Signal(StorageClass="ExportedGlobal", DataType="single")  % The value indicates the wheel driven torque value item related with the air resistance.
ARB_indx_ACCWhlToq2PTRat_sg = Simulink.Signal(StorageClass="ExportedGlobal", DataType="single")  % Gear ratio / wheel radius
ARB_T_WhlDrvnToq_sg = Simulink.Signal(StorageClass="ExportedGlobal", DataType="single")  % The value indicates the requested value on the wheels without the acceleration closed loop.
ARB_a_EstdSlopeCmpValRAW_sg = Simulink.Signal(StorageClass="ExportedGlobal", DataType="single", Unit="m/s^2")  % Estimated Slope before the Low-Pass filter.
ARB_a_EstdSlopeVal_sg = Simulink.Signal(StorageClass="ExportedGlobal", DataType="single")  % The value is limited to [-1,1]
ARB_T_ECMToqReqVal_sg = Simulink.Signal(StorageClass="ExportedGlobal", DataType="single", Unit="Nm")  % The required ECM torque value based on engine model.
DFIn_v_AvgWhlGndVel_sg = Simulink.Signal(StorageClass="ExportedGlobal", DataType="single", Unit="m/s")  % Average Wheel speed
DFIn_a_EstdLongtAccelRtLim_sg = Simulink.Signal(StorageClass="ExportedGlobal", DataType="single")  % DFIn_a_EstdVSELongtAccelRAW_sg is the original estimated value before filtered by actual acceleration
P_DFIn_cntr_DelayCntr_sg = Simulink.Parameter(30, StorageClass="ExportedGlobal", DataType="single")  % The number of delay cycles.

ARB_a_EstdSlopeMnFilt_sg = Simulink.Signal(StorageClass="ExportedGlobal", DataType="single", Unit="m/s^2")  % slope = VSELongtAccel - EstdVSElongtAccel;
  % if positive, implying a uphill slope;
  % otherwise, a downhill slope;
  % Noticeably, the chattering situation should be paid high attention on.

ARB_a_EstdSlopeMnRtLim_sg = Simulink.Signal(StorageClass="ExportedGlobal", DataType="single")  % A rate limit block is added after the mean filter to decrease the chatter of the slope estimation.
P_DFIn_cntr_DelayCntr_d = Simulink.Parameter(30, StorageClass="ExportedGlobal", DataType="double")  % The delay number for the Estimated acceleration filter modular.

DFIn_a_EstdLongtAccelMnFilt_sg = Simulink.Signal(StorageClass="ExportedGlobal", DataType="single")  % The estimated acceleration value obtained after Mean filter.
  % P_DFIn_cntr_DelayCntr_d is the related parameter.

P_AS21_is_DecelTest_bl = Simulink.Parameter(0, StorageClass="ExportedGlobal", DataType="boolean")  % 0 is the normal status
  % 1 is the deceleration test statuss

P_AS21_a_DecelVal_sg = Simulink.Parameter(-0.05, StorageClass="ExportedGlobal", DataType="single")  % -0.05, -0.1,-0.15,-0.20,-0.25,-0.3,-0.35
P_AS21_T_TorqTest_sg = Simulink.Parameter(-800, StorageClass="ExportedGlobal", DataType="single")
C_AS21_20T_a_SlidingResist_Tbl1D = Simulink.Parameter([0 0 0 -0.4 -0.4 -0.4 -0.4 -0.4 -0.4 -0.4 -0.4 -0.4], StorageClass="ExportedGlobal", DataType="single")  % The data is measured by recording the acceleration of a slding vehicle. The actual driver acc-pedal is ZERO and the transmission level is D.

P_ACC_Gx_FSCIncCoeHi_sg = Simulink.Parameter(0.6, StorageClass="ExportedGlobal", DataType="single")  % when EgoSpd < SetSpd,
  % when the Err is large,
  % the parameter will be used as the Proportional Gain.

ARB_a_StsMgntOrgAccelOutput_sg = Simulink.Signal(StorageClass="ExportedGlobal", DataType="single")

P_DFIn_indx_LaneQuality_u8 = Simulink.Parameter(1, StorageClass="ExportedGlobal", DataType="uint8")  % /*For the quality, ME camera has 3 states;
  % 0 means no lane; 1 means low quality lane; 2 means high quality,
  % the value is for the acceptable value, for example 1; if set to 2, it means only high
  % quality lane is used, otherwise no lane */

P_ACC_d_ACCMinGap_sg = Simulink.Parameter(3.5, StorageClass="ExportedGlobal", DataType="single")  % The minimum gap distance when the vehicle speed is 0. Different projects may be set a different value.
P_DFIn_d_FMRdrLOSTLongtDist_u16 = Simulink.Parameter(300, StorageClass="ExportedGlobal", DataType="uint16")  % /*Para_when the radar distance is same with the value, there is no target*/

P_DFIn_d_RdrLatDistThrs_sg = Simulink.Parameter(10, StorageClass="ExportedGlobal", DataType="single", Unit="m")  % /*when the actual lateral distance is larger than the value, and the lasting time is larger than the related counter,
  % the system may not track the target,for example 1.5m*/

P_DFIn_cntr_RdrLatDistOut_u16 = Simulink.Parameter(18, StorageClass="ExportedGlobal", DataType="uint16")  % /*when the time is longer than the counter length which is counter number multiplies the time-step,
  % the system will not track the target*/

P_ACC_perc_MinAccelPdlPos_sg = Simulink.Parameter(0.01, StorageClass="ExportedGlobal", DataType="single")  % The value denotes the minimum value for acceleration gas pedal.
  % Only when the gas pedal position is larger than this value, is the gas pedal
  % considered as pressed.

P_ACC_t_FTCAutoGoTm_sg = Simulink.Parameter(3, StorageClass="ExportedGlobal", DataType="single", Unit="sec")  % Para_when the time length is larger than the para, the ACC will going into StdStl wait status; during wait status the driver operations are needed when the driver wants to drive off automatically;
P_ACC_t_BrkOnlyTmThrs_sg = Simulink.Parameter(5, StorageClass="ExportedGlobal", DataType="single", Unit="sec")  % Para_the maximum Time threshold and after this the brake only mode will exit;
P_ACC_t_OvrrdExitTm_sg = Simulink.Parameter(30, StorageClass="ExportedGlobal", DataType="single", Unit="sec")  % P_time threshold; when larger than the value, the ACC will exit to standby.
P_ACC_v_BrkOnlyDeltaSpd_sg = Simulink.Parameter(5, StorageClass="ExportedGlobal", DataType="single", Unit="m/s")  % The max speed decrease value during Brake only mode.
C_Switch_Off_bl = Simulink.Parameter(0, DataType="boolean")  % Variant, denoting ZERO
C_Switch_On_bl = Simulink.Parameter(1, DataType="boolean")

P_ACC_perc_AccelPdlOvrrdExit_sg = Simulink.Parameter(1.01, StorageClass="ExportedGlobal", DataType="single")  % When the acceleration pedal position is larger than this value,
  % the acc state exits to standby from override state.

ARB_a_ACCSysTgtAccel_sg = Simulink.Signal(StorageClass="ExportedGlobal", DataType="single")  % The acceleration value after fiter to ARB_State_Machine.
ARB_a_VSELongtAccelLPF_sg = Simulink.Signal(StorageClass="ExportedGlobal", DataType="single")
P_ACC_v_MinEmrgcyCruzActv_sg = Simulink.Parameter(2, StorageClass="ExportedGlobal", DataType="single")  % The minimum speed for emergency cruise control.
P_ARB_is_EstdAcceltoSlope_bl = Simulink.Parameter(1, StorageClass="ExportedGlobal", DataType="boolean")  % 1 Estimate the acceleration based on the EstdAccelLongtVal
P_ARB_cntr_SlopeEstdDelay_d = Simulink.Parameter(50, StorageClass="ExportedGlobal", DataType="double")  % The delay number for the slope estimation modular.
P_ACC_v_StdyFTCSpdErrHi_sg = Simulink.Parameter(0.25, StorageClass="ExportedGlobal", DataType="single", Unit="m/s")
P_ACC_v_StdyFTCSpdErrLo_sg = Simulink.Parameter(0.1, StorageClass="ExportedGlobal", DataType="single")

ACC_is_FSCICtrlDdZnOn_bl = Simulink.Signal(StorageClass="ExportedGlobal", DataType="boolean")  % 0 Integral part no dead zone
  % 1 Integral part Dead Zone On

P_ACC_aRt_FSCCmftUpRt_sg = Simulink.Parameter(1, StorageClass="ExportedGlobal", DataType="single", Unit="m/s^3")
P_ACC_aRt_FSCNorUpRt_sg = Simulink.Parameter(1.5, StorageClass="ExportedGlobal", DataType="single", Unit="m/s^3")

P_DFIn_indx_ACCDrvrMode_en = Simulink.Parameter(3, StorageClass="ExportedGlobal", DataType="uint8")  % 1 means comfort;
  % 2 means normal;
  % 3 means sport;

P_ACC_is_FTCStdyCtrlOn_bl = Simulink.Parameter(1, StorageClass="ExportedGlobal", DataType="boolean")  % 0 Off; implying no steady mode control
  % 1 on ; implying steady mode control exists

P_ACC_v_MinCrsSpdThrs_u8 = Simulink.Parameter(0, StorageClass="ExportedGlobal", DataType="uint8")  % The minimum Activation Speed; only if larger than this value,
  % can the system be activated.

P_ACC_V_MinCrsSpd_u8 = Simulink.Parameter(20, StorageClass="ExportedGlobal", DataType="uint8", Unit="Km/h")  % The minimum cruise speed, Unit Km/h
P_ACC_V_MaxCrsSpd_u8 = Simulink.Parameter(150, StorageClass="ExportedGlobal", DataType="uint8", Unit="Km/h")  % The maximum cruise speed, Unit Km/h.

P_ACC_perc_GoGasPdlThrs_sg = SimulinkDemos.Parameter(0.01, DoubleProperty=0, Int32Property=int32(0), LogicalProperty=false, OnOffStringProperty="off", ColorStringProperty="red", StorageClass="ExportedGlobal", DataType="single")  % When the acutal gas pedal position is larger than this value, the driver intention
  % is considered as part of Go request.

DFIn_indx_ADASPrjtCode_en = Simulink.Signal(StorageClass="ExportedGlobal", DataType="Enum: ADASPrjtCode_t")  % enumeration
  % eAS21(0),
  % eEP21(1),
  % eAS22(2),
  % eAS23(3),
  % eAS24(4)

P_DFIn_indx_ADASPrjtCode_u8 = Simulink.Parameter(1, StorageClass="ExportedGlobal", DataType="uint8")  % enumeration
  % eAS21(0),
  % eEP21(1),
  % eAS22(2),
  % eAS23(3),
  % eAS24(4)
  % eAS25(5),
  % eAS26(6),
  % eAS27(7),
  % eAS28(8),
  % eAS29(9),

P_ACC_a_FSCUpLmt_sg = Simulink.Parameter(1.6, StorageClass="ExportedGlobal", DataType="single", Unit="m/s^2")

P_ARB_v_ACCLowSpd_sg = SimulinkDemos.Parameter(1.5, DoubleProperty=0, Int32Property=int32(0), LogicalProperty=false, OnOffStringProperty="off", ColorStringProperty="red", StorageClass="ExportedGlobal", DataType="single")  % When smaller than this value, a different stategy will be adopted.
  % In special, the Engine brake/ Resistance Brake will be disabled.

P_ACC_t_SetSpdActvThrs_sg = Simulink.Parameter(0.02, StorageClass="ExportedGlobal", DataType="single", Unit="sec")  % When the ACC system state is active, while the set speed is not set successfully, this
  % situation is not acceptable. And if the time duration of this situation is larger than
  % the time counter, the acc system state will be changed to In_Active.

P_ARB_T_AS21MinDrvnToq_sg = SimulinkDemos.Parameter(-99, DoubleProperty=0, Int32Property=int32(0), LogicalProperty=false, OnOffStringProperty="off", ColorStringProperty="red", StorageClass="ExportedGlobal", DataType="single")  % In AS21 the signal can be a negative value.
  % In EP21 the signal should be ZERO.

P_ARB_T_EP21MinDrvnToq_sg = SimulinkDemos.Parameter(0, DoubleProperty=0, Int32Property=int32(0), LogicalProperty=false, OnOffStringProperty="off", ColorStringProperty="red", StorageClass="ExportedGlobal", DataType="single")  % In AS21 the signal can be a negative value.
  % In EP21 the signal should be ZERO.

P_ARB_is_SlopeCmpSCSIntv_bl = SimulinkDemos.Parameter(0, DoubleProperty=0, Int32Property=int32(0), LogicalProperty=false, OnOffStringProperty="off", ColorStringProperty="red", StorageClass="ExportedGlobal", DataType="boolean")  % 1 The estimated slope is used to compensate SCS intervention boundary.
  % 0 No Slope compensation.

P_ACC_aRt_ISOHiSpdUpRt_sg = SimulinkDemos.Parameter(2.5, DoubleProperty=0, Int32Property=int32(0), LogicalProperty=false, OnOffStringProperty="off", ColorStringProperty="red", StorageClass="ExportedGlobal", DataType="single", Unit="m/s^3")  % ISO 26262 Page 11

P_ACC_aRt_ISOHiSpdLoRt_sg = SimulinkDemos.Parameter(-2.5, DoubleProperty=0, Int32Property=int32(0), LogicalProperty=false, OnOffStringProperty="off", ColorStringProperty="red", StorageClass="ExportedGlobal", DataType="single", Unit="m/s^3")  % ISO 26262
  % ISO 26262 HiSpd >=20m/s;

P_ACC_aRt_ISOLoSpdUpRt_sg = SimulinkDemos.Parameter(5, DoubleProperty=0, Int32Property=int32(0), LogicalProperty=false, OnOffStringProperty="off", ColorStringProperty="red", StorageClass="ExportedGlobal", DataType="single", Unit="m/s^3")  % ISO 26262 LowSpd <=5m/s;
P_ACC_aRt_ISOLoSpdLoRt_sg = SimulinkDemos.Parameter(-5, DoubleProperty=0, Int32Property=int32(0), LogicalProperty=false, OnOffStringProperty="off", ColorStringProperty="red", StorageClass="ExportedGlobal", DataType="single", Unit="m/s^3")  % ISO 26262 LowSpd <=5m/s;
P_ARB_T_MaxPosToqGap_sg = SimulinkDemos.Parameter(90, DoubleProperty=0, Int32Property=int32(0), LogicalProperty=false, OnOffStringProperty="off", ColorStringProperty="red", StorageClass="ExportedGlobal", DataType="single", Unit="Nm")  % When larger than the parameter, the Engine may sent torque request not allowed.
ARB_T_AllowedMaxToqVal_sg = Simulink.Signal(StorageClass="ExportedGlobal", DataType="single", Unit="Nm")  % The allowed Max Torque Request.

P_DFIn_n_EngRunActvSpd_u16 = SimulinkDemos.Parameter(100, DoubleProperty=0, Int32Property=int32(0), LogicalProperty=false, OnOffStringProperty="off", ColorStringProperty="red", StorageClass="ExportedGlobal", DataType="uint16")  % /* Tunable Parameter.
  % It shall be lower than engine idle speed for every project. */

P_DFIn_n_EngSpdFlt_u16 = SimulinkDemos.Parameter(10000, DoubleProperty=0, Int32Property=int32(0), LogicalProperty=false, OnOffStringProperty="off", ColorStringProperty="red", StorageClass="ExportedGlobal", DataType="uint16")  % The value indicates a speed value when the engine is in fault mode.
P_DFIn_t_ESPActv_sg = SimulinkDemos.Parameter(0.1, DoubleProperty=0, Int32Property=int32(0), LogicalProperty=false, OnOffStringProperty="off", ColorStringProperty="red", StorageClass="ExportedGlobal", DataType="single", Unit="sec")
P_DFIn_t_TCSActv_sg = SimulinkDemos.Parameter(0.1, DoubleProperty=0, Int32Property=int32(0), LogicalProperty=false, OnOffStringProperty="off", ColorStringProperty="red", StorageClass="SimulinkGlobal", DataType="single", Unit="sec")

P_DFIn_t_ABSActv_sg = SimulinkDemos.Parameter(0.1, DoubleProperty=0, Int32Property=int32(0), LogicalProperty=false, OnOffStringProperty="off", ColorStringProperty="red", StorageClass="ExportedGlobal", DataType="single")  % /*When the signal satisfies the entry condition, a counter-func will be triggered.
  % E.g. It may be more proper to trust the ABS_Active=1 only if the counter about  ABS_Active=1 is larger than 15,
  % and the time length is 15*t_sample.*/

P_DFIn_t_TrShftLvrPosNOK_sg = SimulinkDemos.Parameter(0.1, DoubleProperty=0, Int32Property=int32(0), LogicalProperty=false, OnOffStringProperty="off", ColorStringProperty="red", StorageClass="ExportedGlobal", DataType="single", Unit="sec")
ACC_indx_PrevSts_en = Simulink.Signal(StorageClass="ExportedGlobal", DataType="Enum: ACCReqSts_t")  % means the previous status for ACC SystemStatus
ACC_indx_CurrSts_en = Simulink.Signal(StorageClass="ExportedGlobal", DataType="Enum: ACCReqSts_t")  % A middle variant to save the current state.
ACC_a_CurrCycVal_sg = Simulink.Signal(StorageClass="ExportedGlobal", DataType="single", Unit="m/s^2")  % the acceleration value in the Current STEP is saved
ACC_a_ACCSysTgtAccelRaw_sg = Simulink.Signal(StorageClass="ExportedGlobal", DataType="single", Unit="m/s^2")
ACC_a_ACCSysTgtAccelSF_sg = Simulink.Signal(StorageClass="ExportedGlobal", DataType="single", Unit="m/s^2")  % The raw acceleration value from ACC algo-switch stateflow
ACC_a_FTCAccCtrl_sg = Simulink.Signal(StorageClass="ExportedGlobal", DataType="single", Unit="m/s^2")
ACC_a_FTCDistCtrl_sg = Simulink.Signal(StorageClass="ExportedGlobal", DataType="single", Unit="m/s^2")
ACC_a_FTCLoSpdCtrl_sg = Simulink.Signal(StorageClass="ExportedGlobal", DataType="single", Unit="m/s^2")
ACC_a_FTCSpdCtrl_sg = Simulink.Signal(StorageClass="ExportedGlobal", DataType="single", Unit="m/s^2")

ACC_is_CrvteCtrlActv_bl = Simulink.Signal(StorageClass="ExportedGlobal", DataType="boolean")  % 0 No Curve Control
  % 1 Curve Control Intervention

ARB_T_ACCToqReqVal_sg = Simulink.Signal(StorageClass="ExportedGlobal", DataType="single")
DFIn_is_AEBReqEnbl_bl = Simulink.Signal(StorageClass="ExportedGlobal", DataType="boolean")

P_ACC_is_FSCICtrlDdZn_bl = Simulink.Parameter(1, StorageClass="ExportedGlobal", DataType="boolean")  % 1 the Dead Zone On
  % 0 the Dead zone Off

ACC_is_FTCStdy_bl = Simulink.Signal(StorageClass="ExportedGlobal", DataType="boolean")  % 0 Not steady
  % 1 steady following

ACC_is_FSCNegAppchSmlErr_bl = Simulink.Signal(StorageClass="ExportedGlobal", DataType="boolean")
ACC_is_FSCPosAppchSmlErr_bl = Simulink.Signal(StorageClass="ExportedGlobal", DataType="boolean")
ACC_is_FSCIGxNegSmlErr_bl = Simulink.Signal(StorageClass="ExportedGlobal", DataType="boolean")
ACC_is_FSCIGxNegLgrErr_bl = Simulink.Signal(StorageClass="ExportedGlobal", DataType="boolean")
ACC_is_FSCIGxPosLgrErr_bl = Simulink.Signal(StorageClass="ExportedGlobal", DataType="boolean")
ACC_is_FSCIGxPosSmlErr_bl = Simulink.Signal(StorageClass="ExportedGlobal", DataType="boolean")
ACC_is_FSCIntglActv_bl = Simulink.Signal(StorageClass="ExportedGlobal", DataType="boolean")
P_ACC_Gx_FSCIntglCoeHi_sg = Simulink.Parameter(0.01, StorageClass="ExportedGlobal", DataType="single")
ACC_v_FSCIctrlErr_sg = Simulink.Signal(StorageClass="ExportedGlobal", DataType="single")
ACC_Gx_FSCPctrlCoe_sg = Simulink.Signal(StorageClass="ExportedGlobal", DataType="single")
ACC_Ierr_FSCIntgl_sg = Simulink.Signal(StorageClass="ExportedGlobal", DataType="single")
ACC_Ierr_FSCIntglRAW_sg = Simulink.Signal(StorageClass="ExportedGlobal", DataType="single")
ACC_is_FSCIntglSatStfd_bl = Simulink.Signal(StorageClass="ExportedGlobal", DataType="boolean")
P_ACC_aRt_FTCStdyUp_sg = Simulink.Parameter(5, StorageClass="ExportedGlobal", DataType="single", Unit="m/s^3")
P_ACC_aRt_FTCStdyLo_sg = Simulink.Parameter(-2.5, StorageClass="ExportedGlobal", DataType="single", Unit="m/s^3")

P_ARB_Gx_ACCTorqCmp_sg = Simulink.Parameter(15, StorageClass="ExportedGlobal", DataType="single")  % Based on the torque compensation request, the value can reach 50Nm.
  % Therefore, the gain may be around 50;
  % Aug.16, due to the overshoot caused by the P closeloop

ACC_a_FSC4ToqComp_sg = Simulink.Signal(StorageClass="ExportedGlobal", DataType="single", Unit="m/s^2")
ARB_a_AccelErr_sg = Simulink.Signal(StorageClass="ExportedGlobal", DataType="single")
ACC_a_FTCAccelCalcRAW_sg = Simulink.Signal(StorageClass="ExportedGlobal", DataType="single", Unit="m/s^2")  % /*Calculated FTC accel*/
DA_IN_KeyObjLongtRltvDist_sg = Simulink.Signal(StorageClass="ExportedGlobal", DataType="single")
C_DFIn_t_AccelCycFilt_sg = Simulink.Parameter(0.6, DataType="single")
VSELongtAcc_H1HSC1_sg = Simulink.Signal(StorageClass="ExportedGlobal", DataType="single")
P_ACC_aRt_FSCSptLoRt_sg = Simulink.Parameter(-5, StorageClass="ExportedGlobal", DataType="single", Unit="m/s^3")

P_ACC_v_FSCPGxNegErrThrsHi_sg = Simulink.Parameter(-0.2, StorageClass="ExportedGlobal", DataType="single", Unit="m/s")  % Neg Error Hi threshold, when larger than this value and smaller than ZERO,
  % the gain for smaller error is used.

P_ACC_v_BrkOnlyExitSpd_sg = Simulink.Parameter(2, StorageClass="ExportedGlobal", DataType="single", Unit="m/s")  % When smaller than this value, brake only mode exits.
  % This para is a calibration data.

P_ACC_t_StdyTmDistLo_sg = Simulink.Parameter(0.05, StorageClass="ExportedGlobal", DataType="single", Unit="sec")
P_ACC_t_StdyTmDistHi_sg = Simulink.Parameter(0.15, StorageClass="ExportedGlobal", DataType="single", Unit="sec")

P_ACC_t_idlBrkTorqEgh_sg = Simulink.Parameter(1, StorageClass="ExportedGlobal", DataType="single", Unit="sec")  % 1s for example---1s/0.01s = 100.
  % Thus, only if the system counter in
  % idlbrakeEnough_counter_Function is larger than 100, the
  % ACC_is_idleBrkTorqEgh_bl is allowed to set to ONE.

P_ACC_t_ActvBrkIntvThrs_sg = Simulink.Parameter(300, StorageClass="ExportedGlobal", DataType="single", Unit="sec")  % This parameter indicates the longest time for Idle brake state.
  % For example, if the value is set as 300 sec, the idle brake state
  % will be switched to the other one as long as the time reaches at 300 s.

P_ACC_v_FSCPGxNegErrThrsLo_sg = Simulink.Parameter(-0.35, StorageClass="ExportedGlobal", DataType="single", Unit="m/s")
P_ACC_aRt_FSCSptUpRtLo_sg = Simulink.Parameter(0.8, StorageClass="ExportedGlobal", DataType="single")
P_ACC_a_FTCAccelCalcLorLmt_sg = Simulink.Parameter(-5, StorageClass="ExportedGlobal", DataType="single", Unit="m/s^2")  % The lower limit of the FTCAccelCalcaltion value.
P_ACC_aRt_FSCSptUpRtHi_sg = Simulink.Parameter(1.6, StorageClass="ExportedGlobal", DataType="single", Unit="m/s^3")
ACC_a_FSC4ToqCompRAW_sg = Simulink.Signal(StorageClass="ExportedGlobal", DataType="single", Unit="m/s^2")
ACC_a_FSCAccelSat_sg = Simulink.Signal(StorageClass="ExportedGlobal", DataType="single", Unit="m/s^2")
ACC_a_FSCAccelSatSw_sg = Simulink.Signal(StorageClass="ExportedGlobal", DataType="single", Unit="m/s^2")
ACC_a_FSCIntglRAW_sg = Simulink.Signal(StorageClass="ExportedGlobal", DataType="single", Unit="m/s^2")
ACC_a_FSCIntglRAWSat_sg = Simulink.Signal(StorageClass="ExportedGlobal", DataType="single", Unit="m/s^2")
ACC_a_FTCAccelCalcRAWSatRtSw_sg = Simulink.Signal(StorageClass="ExportedGlobal", DataType="single", Unit="m/s^2")
ACC_a_FTCAccelCalcRAWSatRt_sg = Simulink.Signal(StorageClass="ExportedGlobal", DataType="single", Unit="m/s^2")
ACC_a_FTCAccelCalcRAWSat_sg = Simulink.Signal(StorageClass="ExportedGlobal", DataType="single", Unit="m/s^2")
P_RCA_d_MaxMvDist_sg = Simulink.Parameter(10, StorageClass="ExportedGlobal", DataType="single")  % /* when larger than the value, the RCA should exit.*/
P_RCA_t_DfltTmDist_sg = Simulink.Parameter(1, StorageClass="ExportedGlobal", DataType="single")  % /*the time distance in RCA is very small to provide the potential free space*/
P_ACC_v_FSCIGxNegErrThrsLo_sg = Simulink.Parameter(-0.25, StorageClass="ExportedGlobal", DataType="single", Unit="m/s")  % /*changed 0827 from -0.35*/
P_ACC_v_FSCIGxNegErrThrsHi_sg = Simulink.Parameter(-0.15, StorageClass="ExportedGlobal", DataType="single", Unit="m/s")  % /*changed 0827 from -0.2*/

P_ACC_a_FSCCnvgDesnThrs_sg = Simulink.Parameter(0.2, StorageClass="ExportedGlobal", DataType="single")  % Positive Value.
  % Under Fsc mode, when the difference value between Estimated Acceleration
  % and FSC Required Acceleration is larger than this parameter,
  % a system counter P_ACC_cntr_idlBrkTorqEgh_u16 will be counted.

ACC_is_idlBrkTorqEgh_bl = Simulink.Signal(StorageClass="ExportedGlobal", DataType="boolean")  % The signal is used to evaluate if the idle brake is enough.
  % For example, when meeting the downhill situation, the ego speed may exceed the set speed limit
  % due to the insufficient brake torque.

DFIn_indx_RCARrTgtSts_en = Simulink.Signal(StorageClass="ExportedGlobal", DataType="single")
DFIn_is_RCAExitCondStfd_bl = Simulink.Signal(StorageClass="ExportedGlobal", DataType="boolean")
DFIn_is_RCAActvExitCondStfd_bl = Simulink.Signal(StorageClass="ExportedGlobal", DataType="boolean")
DFIn_is_RCASwOnSw_bl = Simulink.Signal(StorageClass="ExportedGlobal", DataType="boolean")
P_RCA_perc_AccelPosThrs_sg = Simulink.Parameter(0.2, StorageClass="ExportedGlobal", DataType="single")
RCA_is_DistOvrfl_bl = Simulink.Signal(StorageClass="ExportedGlobal", DataType="boolean")

RCA_indx_ReqSts_en = Simulink.Signal(StorageClass="ExportedGlobal", DataType="Enum: RCAReqSts_t")  % eRCAStsSleep     (0),
  % eRCAStsOff       (1),
  % eRCAStsStandby   (2),
  % eRCAStsBrkOnly   (3),
  % eRCAStsActv      (4),
  % eRCAStsOvrrd     (5),
  % eRCAStsError     (6),

RCA_indx_DngrLvl_sg = Simulink.Signal(StorageClass="ExportedGlobal", DataType="single")
DFIn_is_AccelCondStfd_bl = Simulink.Signal(StorageClass="ExportedGlobal", DataType="boolean")
RCA_is_ActvAccelTmStfd_bl = Simulink.Signal(StorageClass="ExportedGlobal", DataType="boolean")
RCA_indx_ActvSts_en = Simulink.Signal(StorageClass="ExportedGlobal", DataType="Enum: RCAActvSts_t")
ARB_indx_RCWActvSts_en = Simulink.Signal(StorageClass="ExportedGlobal", DataType="Enum: RCWActvSts_t")
P_RCA_d_StcMvDist_sg = Simulink.Parameter(10, StorageClass="ExportedGlobal")  % /*The max distance allowed to move forward in RCA_Static Mode*/
RCA_a_StcAccelReqVal_sg = Simulink.Signal(StorageClass="ExportedGlobal", DataType="single", Unit="m/s2")
RCA_a_DycAccelReqVal_sg = Simulink.Signal(StorageClass="ExportedGlobal", DataType="single", Unit="m/s^2")
P_ARB_a_AS21ECMTgtAccel_sg = SimulinkDemos.Parameter(0.1, DoubleProperty=0, Int32Property=int32(0), LogicalProperty=false, OnOffStringProperty="off", ColorStringProperty="red", StorageClass="ExportedGlobal", DataType="single", Unit="m/s^2")  % In AS21 project, when the 0 is sent to ESP, ESP also brake, therefore even in Acceleration status, set the acceleration value as 0.11.
P_ARB_a_EP21ECMTgtAccel_sg = SimulinkDemos.Parameter(0.1, DoubleProperty=0, Int32Property=int32(0), LogicalProperty=false, OnOffStringProperty="off", ColorStringProperty="red", StorageClass="ExportedGlobal", DataType="single", Unit="m/s^2")
P_RCA_a_TgtAccel_sg = Simulink.Parameter(2, StorageClass="ExportedGlobal", DataType="single", Unit="m/s^2")
RCA_a_AccelReqCalcVal_sg = Simulink.Signal(StorageClass="ExportedGlobal", DataType="single", Unit="m/s^2")
RCA_a_AccelReqVal_sg = Simulink.Signal(StorageClass="ExportedGlobal", DataType="single", Unit="m/s^2")
P_ARB_aRt_ACCAccHi_sg = Simulink.Parameter(5, StorageClass="ExportedGlobal", DataType="single", Unit="m/s^3")
P_ARB_aRt_ACCDecLo_sg = Simulink.Parameter(-4, StorageClass="ExportedGlobal", DataType="single", Unit="m/s^3")
P_ARB_aRt_EstdSlopeMnRtLo_sg = Simulink.Parameter(-0.07, StorageClass="ExportedGlobal", DataType="single", Unit="m/s^3")
P_ARB_aRt_EstdSlopeMnRtUp_sg = Simulink.Parameter(0.07, StorageClass="ExportedGlobal", DataType="single", Unit="m/s^3")  % The parameter is used to limit the slope increase rate, which is an calibration para.
P_ARB_aRt_EstdVSELongtAccelLo_sg = Simulink.Parameter(-2, StorageClass="ExportedGlobal", DataType="single", Unit="m/s^3")
P_ACC_a_FSCLoLmt_sg = Simulink.Parameter(-1.5, StorageClass="ExportedGlobal", DataType="single", Unit="m/s^2")
P_ACC_a_FSCSptInflPt_sg = Simulink.Parameter(0.8, StorageClass="ExportedGlobal", DataType="single", Unit="m/s^2")  % When larger than this value , the acceleration rate will be slow down.
P_ACC_a_FTCAccelCalcUprLmt_sg = Simulink.Parameter(2, StorageClass="ExportedGlobal", DataType="single", Unit="m/s^2")
P_ACC_a_FTCStopped_sg = Simulink.Parameter(-2, StorageClass="ExportedGlobal", DataType="single", Unit="m/s^2")  % When the system status is standstill (wait), the acceleration is -2 m/s^2.
P_ACC_aRt_ACCUprRtNor_sg = Simulink.Parameter(2, StorageClass="ExportedGlobal", DataType="single", Unit="m/s^3")  % /*when acceleration is positive; e.g.the Upper Rt limit _Normal is 2 m/s^3*/
P_ACC_aRt_ACCUprRtFst_sg = Simulink.Parameter(5, StorageClass="ExportedGlobal", DataType="single", Unit="m/s^3")  % /*when acceleration is negative; e.g.the Upper Rt limit _Fast is 5 m/s^3*/
P_ACC_aRt_ACCLorRtNor_sg = Simulink.Parameter(-2, DataType="single", Unit="m/s^3")  % /*when acceleration is negative; e.g.the lower Rt limit is -2 m/s^3*/
P_ACC_aRt_ACCLorRtFst_sg = Simulink.Parameter(-5, StorageClass="ExportedGlobal", DataType="single", Unit="m/s^3")  % /*when acceleration is positive*/
DFIn_v_RCAFntTgtLongtRltvSpd_sg = Simulink.Signal(StorageClass="ExportedGlobal", DataType="single", Unit="m/s")
DFIn_v_RCARrTgtLongtRltvSpd_sg = Simulink.Signal(StorageClass="ExportedGlobal", DataType="single", Unit="m/s")
DFIn_v_RCARrTgtLongtSpd_sg = Simulink.Signal(StorageClass="ExportedGlobal", DataType="single", Unit="m/s")
DFIn_v_RltVehSpd_sg = Simulink.Signal(StorageClass="ExportedGlobal", DataType="single", Unit="m/s")  % /*Vhead - V ego vehicle. Positive value means the front vehicle runs faster*/
DFIn_wD_StrgWhlAngGrd_sg = Simulink.Signal(StorageClass="ExportedGlobal", DataType="single", Unit="deg/s")
DFIn_d_FMRdrLOSTLongtDist_u16 = Simulink.Signal(StorageClass="ExportedGlobal", DataType="uint16", Unit="m")
DFIn_d_RCAFntTgtLongtDist_sg = Simulink.Signal(StorageClass="ExportedGlobal", DataType="single", Unit="m")
DFIn_d_RCARrTgtLongtSpd_sg = Simulink.Signal(StorageClass="ExportedGlobal", DataType="single", Unit="m")
DFIn_d_RrTgtLatDist_sg = Simulink.Signal(StorageClass="ExportedGlobal", DataType="single", Unit="m")
DFIn_d_RrTgtLongtDist_sg = Simulink.Signal(StorageClass="ExportedGlobal", DataType="single", Unit="m")
ACC_d_FTCDistCtrl_sg = Simulink.Signal(StorageClass="ExportedGlobal", DataType="single", Unit="m")
ACC_a_ACCTgtISORAW_sg = Simulink.Signal(StorageClass="ExportedGlobal", DataType="single", Unit="m/s^2")

P_RCA_v_StcMaxRrRltSpd_sg = Simulink.Parameter(1.5, StorageClass="ExportedGlobal", DataType="single")  % /*Even if the front vehicle speed is very high in Static RCA Mode,
  % the maximum RltSpd between the Fnt and the Ego is this Parameter,
  % to avoid the unnecessary strong Acceleration*/

P_RCA_t_MidTmDistCmp_sg = Simulink.Parameter(0.35, StorageClass="ExportedGlobal", DataType="single")  % /* Time Distance compensation for RCA Waringing Distance_Mid Level*/
P_RCA_t_MinTmDistCmp_sg = Simulink.Parameter(0.2, StorageClass="ExportedGlobal", DataType="single")  % /* Time Distance compensation for RCA Waringing Distance_Min Level*/

DFIn_indx_AEBFntTgtSts_en = Simulink.Signal(StorageClass="ExportedGlobal", DataType="single")  % 0x0 No object
  % 0x1 Object exists

DFIn_indx_ACCFntTgtSts_en = Simulink.Signal(StorageClass="ExportedGlobal", DataType="single")
DFIn_indx_RCAFntTgtSts_bl = Simulink.Signal(StorageClass="ExportedGlobal", DataType="boolean")
P_ACC_v_FSCPGxPosErrThrsHi_sg = Simulink.Parameter(0.13, StorageClass="ExportedGlobal", DataType="single", Unit="m/s")
P_ACC_v_FSCPGxPosErrThrsLo_sg = Simulink.Parameter(0.08, StorageClass="ExportedGlobal", DataType="single", Unit="m/s")
P_FSC_Gx_SpdLmtHi_sg = Simulink.Parameter(2, StorageClass="ExportedGlobal", DataType="single")
P_ACC_v_FSCLoSpdThrs_sg = Simulink.Parameter(5, StorageClass="ExportedGlobal", DataType="single", Unit="m/s")
P_FSC_Gx_SpdLmtLo_sg = Simulink.Parameter(0.8, StorageClass="ExportedGlobal", DataType="single")
DA_IN_d_RMRdrLongtDist_sg = Simulink.Signal(StorageClass="ExportedGlobal", DataType="single")
P_ACC_aRt_LoSpdUpLmt_sg = Simulink.Parameter(0.7, StorageClass="ExportedGlobal", DataType="single")  % /*Low Speed situation, Up limit to limit the acceleration*/
P_ACC_aRt_NormSpdUpLmt_sg = Simulink.Parameter(2, StorageClass="ExportedGlobal", DataType="single")
P_ACC_aRt_FSCUprRtFst_sg = Simulink.Parameter(2.5, StorageClass="ExportedGlobal", DataType="single")
P_ACC_aRt_FSCLorRtFst_sg = Simulink.Parameter(-2.5, StorageClass="ExportedGlobal", DataType="single")
P_ACC_aRt_FSCLorRtNorm_sg = Simulink.Parameter(-2, StorageClass="ExportedGlobal", DataType="single")

P_EP21_indx_ACCMsgTest_u8 = Simulink.Parameter(8, StorageClass="ExportedGlobal", DataType="uint8")  % 9 Radar Error
  % 8  press resume switch to go
  % 7 Driver Takeover Request
  % 6 ACC is switched off
  % 5 ACC is switched on
  % 4 ACC is in error mode
  % 3 Active
  % 2 ACC is cancelled
  % 1 unable to active ACC
  % 0 No display

P_ACC_Gx_FSCIncCoeLo_sg = Simulink.Parameter(0.4, StorageClass="ExportedGlobal", DataType="single")  % /*when EgoSpd < SetSpd,
  % when the Err is small,
  % the parameter will be used as the Proportional Gain.
  % changed to 0.3 from 0.2 in Sep.03*/

ACC_is_FSCCtrlActv_bl = Simulink.Signal(StorageClass="ExportedGlobal", DataType="boolean")
DFIn_indx_ACCTgtSts_en = Simulink.Signal(StorageClass="ExportedGlobal", DataType="single")
ARB_a_StcACCTgtAccel_sg = Simulink.Signal(StorageClass="ExportedGlobal", DataType="single")
P_ACC_d_StdstlDistThrs_sg = Simulink.Parameter(7, StorageClass="ExportedGlobal", DataType="single")

P_ACC_is_FTCLoSpdCtrlOn_bl = Simulink.Parameter(1, StorageClass="ExportedGlobal", DataType="single")  % 0 Off
  % 1 On which means a special alogrithm will be used in FTC for Stopping case.

RCA_d_NoFntVehMvdDist_sg = Simulink.Signal(StorageClass="ExportedGlobal", DataType="single")
P_RCA_t_MaxTmDistCmp_sg = Simulink.Parameter(0.35, StorageClass="ExportedGlobal", Unit="s")  % /* Time Distance compensation for RCA Waringing Distance_Max Level*/
ACC_is_FTCAlgoActv_bl = Simulink.Signal(StorageClass="ExportedGlobal", DataType="boolean")
RCA_is_SysDyc_bl = Simulink.Signal(StorageClass="ExportedGlobal", DataType="boolean")
RCA_is_DynDistOvrfl_bl = Simulink.Signal(StorageClass="ExportedGlobal", DataType="boolean")
RCA_is_StcDistOvrfl_bl = Simulink.Signal(StorageClass="ExportedGlobal", DataType="boolean")
RCA_d_StcwFntVehFreeDist_sg = Simulink.Signal(StorageClass="ExportedGlobal", DataType="single")
RCA_d_StcNoFntVehFreeDist_sg = Simulink.Signal(StorageClass="ExportedGlobal", DataType="single")
ARB_is_RCAActv_bl = Simulink.Signal(StorageClass="ExportedGlobal", DataType="boolean")
RCA_v_EntrySpd_sg = Simulink.Signal(StorageClass="ExportedGlobal", DataType="single")
RCA_d_DynwFntVehFreeDist_sg = Simulink.Signal(StorageClass="ExportedGlobal", DataType="single")
RCA_v_StcwFntVehRltSpd_sg = Simulink.Signal(StorageClass="ExportedGlobal", DataType="single")
RCA_d_DycNoFntVehFreeDist_sg = Simulink.Signal(StorageClass="ExportedGlobal", DataType="single")
RCA_is_ActvReset_bl = Simulink.Signal(StorageClass="ExportedGlobal", DataType="boolean")
DFIn_IN_DgrObjId_u8 = Simulink.Signal(StorageClass="ExportedGlobal", DataType="uint8")
DFIn_indx_LOCKONID_u8 = Simulink.Signal(StorageClass="ExportedGlobal", DataType="uint8")
RCA_a_StcAccelSpdReqVal_sg = Simulink.Signal(StorageClass="ExportedGlobal", DataType="single")
RCA_a_DycAccelDistReqVal_sg = Simulink.Signal(StorageClass="ExportedGlobal", DataType="single")
RCA_a_DycAccelSpdReqVal_sg = Simulink.Signal(StorageClass="ExportedGlobal", DataType="single")
P_RCA_cnt_AccelTmCtrThrs_u16 = Simulink.Parameter(5, StorageClass="ExportedGlobal", DataType="uint16")
RCA_a_StcAccelDistReqVal_sg = Simulink.Signal(StorageClass="ExportedGlobal", DataType="single")
RCA_is_DynDistOvrflRAW_bl = Simulink.Signal(StorageClass="ExportedGlobal", DataType="boolean")
DPO_indx_ACCAccReqStsHSC2_u8 = Simulink.Signal(StorageClass="ExportedGlobal", DataType="uint8")
RCA_d_DistCtrlLvl_sg = Simulink.Signal(StorageClass="ExportedGlobal", DataType="single")
RCW_d_DistMaxLvl_sg = Simulink.Signal(StorageClass="ExportedGlobal", DataType="single")
RCW_d_DistMidLvl_sg = Simulink.Signal(StorageClass="ExportedGlobal", DataType="single")
RCW_d_DistMinLvl_sg = Simulink.Signal(StorageClass="ExportedGlobal", DataType="single")

RCW_indx_ReqSts_en = Simulink.Signal(StorageClass="ExportedGlobal", DataType="Enum: RCWReqSts_t")  % eRCWStsSleep     (0),
  % eRCWStsOff       (1),
  % eRCWStsStandby   (2),
  % eRCWStsBrkOnly   (3),
  % eRCWStsActv      (4),
  % eRCWStsError     (5),

RCA_d_wFntDsrdDist_sg = Simulink.Signal(StorageClass="ExportedGlobal", DataType="single")
RCA_is_StcwFntTgtExitStfd_bl = Simulink.Signal(StorageClass="ExportedGlobal", DataType="boolean")
RCA_is_StcNoFntTgtExitStfd_bl = Simulink.Signal(StorageClass="ExportedGlobal", DataType="boolean")
RCA_is_DynwFntTgtExitStfd_bl = Simulink.Signal(StorageClass="ExportedGlobal", DataType="boolean")
RCA_is_DynNoFntTgtExitStfd_bl = Simulink.Signal(StorageClass="ExportedGlobal", DataType="boolean")
RCA_d_wFntVehMvdDist_sg = Simulink.Signal(StorageClass="ExportedGlobal", DataType="single")
P_RCA_d_wFntMaxMvDist_sg = Simulink.Parameter(10, StorageClass="ExportedGlobal", DataType="single")
RCA_v_DycNoFntVehRltSpd_sg = Simulink.Signal(StorageClass="ExportedGlobal", DataType="single")
RCW_indx_ActvSts_en = Simulink.Signal(StorageClass="ExportedGlobal", DataType="Enum: RCWActvSts_t")
DFIn_is_RCAAccelEnbl_bl = Simulink.Signal(StorageClass="ExportedGlobal")
DFIn_is_RCWReqEnbl_bl = Simulink.Signal(StorageClass="ExportedGlobal")
ACC_a_PrevCycVal_sg = Simulink.Signal(StorageClass="ExportedGlobal", DataType="single", Unit="m/s^2")  % the acceleration value in the PREVIOUS STEP is saved
ACC_a_FTCAccelFnlRaw_sg = Simulink.Signal(StorageClass="ExportedGlobal", DataType="single", Unit="m/s^2")
ACC_a_FSC4ToqCompRAWSAT_sg = Simulink.Signal(StorageClass="ExportedGlobal", DataType="single", Unit="m/s^2")
DFIn_is_RCAEnCondStfd_bl = Simulink.Signal(StorageClass="ExportedGlobal", DataType="boolean")
P_ACC_v_GoReqThrs_sg = Simulink.Parameter(0.13, StorageClass="ExportedGlobal", DataType="single", Unit="m/s")
RCA_v_DycwFntVehRltSpd_sg = Simulink.Signal(StorageClass="ExportedGlobal", DataType="single")
RCA_v_StcNoFntVehRltSpd_sg = Simulink.Signal(StorageClass="ExportedGlobal", DataType="single")
RCA_is_DistOvrflRAW_bl = Simulink.Signal(StorageClass="ExportedGlobal", DataType="boolean")
K_sys_delay = 0.2
P_RCA_a_AccelLorlmt_sg = Simulink.Parameter(-1, StorageClass="ExportedGlobal", DataType="single", Unit="m/s^2")  % /*The maximum deceleration allowed by RCA system*/
Param = Simulink.Parameter([])
ACC_is_FTCLoSpdCtrlActv_bl = Simulink.Signal(StorageClass="ExportedGlobal", DataType="boolean")
EPO_is_ACCSdslReq_bl = Simulink.Signal(StorageClass="ExportedGlobal", DataType="boolean")
EPO_v_EgoAvgVehSpd_sg = Simulink.Signal(StorageClass="ExportedGlobal", DataType="single")
EPO_is_ACCGoReq_bl = Simulink.Signal(StorageClass="ExportedGlobal", DataType="boolean")
DFIn_T_EnToqActuExtdRng_sg = Simulink.Signal(StorageClass="ExportedGlobal", DataType="single")
DFIn_T_EnToqDrvrReqdExtdRng_sg = Simulink.Signal(StorageClass="ExportedGlobal", DataType="single")
DFIn_T_EnToqMinExtdRng_sg = Simulink.Signal(StorageClass="ExportedGlobal", DataType="single")
DFIn_T_EnToqMaxExtdRng_sg = Simulink.Signal(StorageClass="ExportedGlobal", DataType="single")
DFIn_is_OAFOn_R_bl = Simulink.Signal(StorageClass="ExportedGlobal", DataType="boolean")
DFIn_is_OAFOn_L_bl = Simulink.Signal(StorageClass="ExportedGlobal", DataType="boolean")
ACC_v_FSCSetSpdErr_sg = Simulink.Signal(StorageClass="ExportedGlobal", DataType="single")
DPO_is_ACCToqReqSts_u8 = Simulink.Signal(StorageClass="ExportedGlobal", DataType="uint8")

P_ACC_v_FSCIGxPosErrThrsLo_sg = Simulink.Parameter(0.04, StorageClass="ExportedGlobal", DataType="single", Unit="m/s")  % /*changed 0827 from 0.15；
  % changed 0903 to 0.08*/

P_ACC_v_FSCIGxPosErrThrsHi_sg = Simulink.Parameter(0.13, StorageClass="ExportedGlobal", DataType="single", Unit="m/s")  % /*changed 0827 from 0.35
  % change to 0.13 in 0903
  % 0.5 = 0.13* 3.6*/

ACC_V_ACCSetSpdIPKRAW_sg = Simulink.Signal(StorageClass="ExportedGlobal", DataType="single")
DPO_is_RCAActvCtrl_bl = Simulink.Signal(StorageClass="ExportedGlobal", DataType="boolean")
DPO_is_RCAActvOrPssvCtrl_bl = Simulink.Signal(StorageClass="ExportedGlobal", DataType="boolean")
P_RCA_a_AccelUprlmt_sg = Simulink.Parameter(3, StorageClass="ExportedGlobal", DataType="single", Unit="m/s^2")  % /*The maximum acceleration allowed by RCA system*/

P_RCA_Gx_DistCtrlCoe_sg = Simulink.Parameter(0.3, StorageClass="ExportedGlobal", DataType="single")  % 0925 0.23
  % 0926 0.35

P_RCA_Gx_SpdCtrlCoe_sg = Simulink.Parameter(0.82, StorageClass="ExportedGlobal", DataType="single")  % 0.63 until Sep 26
  % changed to 0.82 inSep26

P_RCA_d_DynMvDist_sg = Simulink.Parameter(10, StorageClass="ExportedGlobal", DataType="single")  % /*The maximum allowed distance to move forward in RCA_dynamic mode*/
ARB_T_SmtDrvToqReqVal_sg = Simulink.Signal(StorageClass="ExportedGlobal", DataType="single")
ARB_a_DrvnToqReq_sg = Simulink.Signal(StorageClass="ExportedGlobal", DataType="single")
P_ARB_Rt_ToqInc_sg = Simulink.Parameter(6, StorageClass="ExportedGlobal", DataType="single")  % RCA Torque Increase Rate

P_ACC_d_GoReqDistHyst_sg = Simulink.Parameter(0.5, StorageClass="ExportedGlobal", DataType="single", Unit="m")  % the Ego vehicle may move forward by ACC torque request, since if the Head vehicle speed is much larger,
  % the acceleration calculated by ACC may be positive.

ACC_a_FSCAlgoSwFilt_sg = Simulink.Signal(StorageClass="ExportedGlobal", DataType="single", Unit="m/s^2")
DFIn_a_EstdLongtAccel30CycFilt_sg = Simulink.Signal(StorageClass="ExportedGlobal", DataType="single")
DFIn_a_EstdLongtAccel30cycMnFilt_sg = Simulink.Signal(StorageClass="ExportedGlobal", DataType="single")
DFIn_a_EstdLongtAccel30cycRtLim_sg = Simulink.Signal(StorageClass="ExportedGlobal", DataType="single")
ACC_Gx_FSCIctrlCoe_sg = Simulink.Signal(StorageClass="ExportedGlobal", DataType="single")
ARB_is_ESPIntvReqHiSpd_bl = Simulink.Signal(StorageClass="ExportedGlobal", DataType="boolean")
Sig6 = Simulink.Signal()
Sig7 = Simulink.Signal()
Sig8 = Simulink.Signal()
ARB_T_NorSituBaseEngTorq_sg = Simulink.Signal(StorageClass="ExportedGlobal", DataType="single")

C_EP21_a_SlidingResist_Tbl1D = SimulinkDemos.Parameter([0 -0.02 -0.1 -0.105 -0.117 -0.117 -0.1189 -0.125 -0.127 -0.196 -0.4 -0.425], DoubleProperty=0, Int32Property=int32(0), LogicalProperty=false, OnOffStringProperty="off", ColorStringProperty="red", StorageClass="ExportedGlobal", DataType="single")  % 0925
  % from [0	0	0	-0.270	-0.27	-0.27	-0.26	-0.26 -0.27-0.27-0.280]	-0.2880
  % changed to [0 0 -0.01 -0.01 -0.01 -0.01 -0.01 -0.06 -0.07 -0.07 -0.088 -0.088]
  % 0	-0.02	-0.10	-0.105	-0.117	-0.117	-0.1189-0.125	-0.127	-0.1960	-0.40	-0.425000000000000

ARB_is_ECMIntvReqHiSpd_bl = Simulink.Signal(StorageClass="ExportedGlobal", DataType="boolean")
P_ARB_TRt_ACCTorqCmpLo_sg = Simulink.Parameter(-6.875, StorageClass="ExportedGlobal", DataType="single", Unit="Nm/s")
P_VDC_ACC_Gx_ModeSwFSCFilt_sg = Simulink.Parameter(0.04, StorageClass="ExportedGlobal", DataType="single")  % Para_the filter gain for mode switching; the smaller the data will be the smoother but lower sensitivity;
ACC_a_FTCSetSpdErr_sg = Simulink.Signal(StorageClass="ExportedGlobal", DataType="single", Unit="m/s^2")  % In FTC mode, the acceleration request from only SetSpeed Error
ACC_d_FTCDeltaDist_sg = Simulink.Signal(StorageClass="ExportedGlobal", DataType="single", Unit="m")  % The actual relative distance minus the desired Gap Distance. Unit m.
ACC_a_FTCLoSpdCtrlRAW_sg = Simulink.Signal(StorageClass="ExportedGlobal", DataType="single", Unit="m/s^2")  % The acceleration value obtained from the Low Speed Stopping Control Algo.
ACC_d_FTCZeroSpdGapDist_sg = Simulink.Signal(StorageClass="ExportedGlobal", DataType="single", Unit="m")  % The relative distance minus the 0-speed Gap desired distance.
ACC_v_FTCSetSpdErr_sg = Simulink.Signal(StorageClass="ExportedGlobal", DataType="single")
ACC_a_FTCAccelDyn_sg = Simulink.Signal(StorageClass="ExportedGlobal", DataType="single")  % The acceleration before SBF modular.
ACC_is_FTCPosApproZeroPnt_bl = Simulink.Signal(StorageClass="ExportedGlobal", DataType="boolean")
ACC_a_HSFTCAccel_sg = Simulink.Signal(StorageClass="ExportedGlobal", DataType="single")
ACC_a_FTCAccelSBFRAW_sg = Simulink.Signal(StorageClass="ExportedGlobal", DataType="single", Unit="m/s^2")  % The raw data for signal ACC_a_FTCAccelSBF_sg
P_ACC_aRt_ISOLoSpdRtInf_sg = Simulink.Parameter(100, DataType="single")  % ACC_aRt_ISOLoSpdLoRtGen_sg this value is to cancel the limitation of the Rate limiter block.