% Simulink data dictionary Platform_ACCAEB_CORE_IN.sldd

AccAebInputs = Simulink.Bus(DataScope="Exported", HeaderFile="SVDC_ACCAEB_Interface")
  ID_LOCKON_u8: uint8
  CCSwStsSpdIncSwAHSC1_u8: uint8
  CCSwStsSpdDecSwAHSC1_u8: uint8
  CCSwStsSetSwAHSC1_u8: uint8
  CCSwStsRsmSwAHSC1_u8: uint8
  CCSwStsOnSwAHSC1_u8: uint8
  CCSwStsCanclSwAHSC1_u8: uint8
  SysPwrMd_H1HSC1_u8: uint8
  TrShftLvrPosHSC1_u8: uint8
  VELOCITY_LOCKON_d: double
  WhlGndVelRDrvn_H1HSC2_d: double
  WhlGndVelLDrvn_H1HSC2_d: double
  WhlGndVelRNonDrvn_H1HSC2_d: double
  WhlGndVelLNonDrvn_H1HSC2_d: double
  X_POSITION_LOCKON_d: double
  Y_POSITION_LOCKON_d: double
  VSELongtAcc_H1HSC1_d: double
  BrkPdlPos_H1HSC1_d: double
  PtBrkPdlDscrtInptStsHSC1_u8: uint8
  StrgWhlAngGrd_HSC2_d: double
  StrgWhlAngHSC2_d: double
  AccelActuPosHSC1_d: double
  VehDynYawRate_H1HSC1_d: double
  TrEstdGear_HSC1_u8: uint8
  EnTypHSC2_u8: uint8
  EnSpdHSC1_d: double
  DrvrSbltAtcHSC1_u8: uint8
  EPBAppcnStsHSC1_u8: uint8
  RDircnIOHSC1_b: boolean
  LDircnIOHSC1_b: boolean
  EnToqActuExtdRngHSC1_d: double
  EnToqDrvrReqdExtdRngHSC1_d: double
  EnToqMinExtdRngHSC1_d: double
  EnToqMaxExtdRngHSC1_d: double
  AccelEfctvPosHSC1_d: double
  Lane0_Lane_Mark_Quality: uint8
  Lane0_Lane_View_Range_Start: double
  Lane0_Lane_View_Range_End: double
  Lane0_C0_Lane_Position: double
  Lane0_C1_Heading_Angle: double
  Lane0_C2_Lane_Curvature: double
  Lane0_C3_Lane_Curvature_Driv: double
  Lane1_Lane_Mark_Quality: uint8
  Lane1_Lane_View_Range_Start: double
  Lane1_Lane_View_Range_End: double
  Lane1_C0_Lane_Position: double
  Lane1_C1_Heading_Angle: double
  Lane1_C2_Lane_Curvature: double
  Lane1_C3_Lane_Curvature_Driv: double
  Lane2_Lane_Mark_Quality: uint8
  Lane2_Lane_View_Range_Start: double
  Lane2_Lane_View_Range_End: double
  Lane2_C0_Lane_Position: double
  Lane2_C1_Heading_Angle: double
  Lane2_C2_Lane_Curvature: double
  Lane2_C3_Lane_Curvature_Driv: double
  Lane3_Lane_Mark_Quality: uint8
  Lane3_Lane_View_Range_Start: double
  Lane3_Lane_View_Range_End: double
  Lane3_C0_Lane_Position: double
  Lane3_C1_Heading_Angle: double
  Lane3_C2_Lane_Curvature: double
  Lane3_C3_Lane_Curvature_Driv: double
  RrFogLghtOnHSC1_b: boolean
  FrtFogLghtOnHSC1: boolean
  DipdBeamLghtOnHSC1: boolean
  MainBeamLghtOnHSC1: boolean
  DA_IN_indx_RCARrTgtID_u8: uint8
  DA_IN_v_RMRltVehSpd_sg: single
  DA_IN_d_RMRdrLatDist_sg: single
  DA_IN_d_RMRdrLongtDist_sg: single
  DA_IN_DgrObjId_u8: uint8
  DA_IN_DgrObjLatRltvDist_sg: single
  DA_IN_DgrObjLatRltvSpd_sg: single
  DA_IN_DgrObjLongtRltvDist_sg: single
  DA_IN_DgrObjSyncCtr_u8: uint8
  DA_IN_DgrObjLongtRltvSpd_sg: single